# Grasshopper definition visualiser.gh (Grasshopper 1.0.7)

path = FilePath("C:\Users\Chee Meng\OneDrive - National University of Singapore\Type0\Building a Timber House\Generative Layouts\ES Slicing Floorplan\output.out")
file = ReadFile(File=path, PerLineParse=True)
split = TextSplit(Text=file, Separators=" ")
panel = Panel(split)
split_2 = SplitList(List=panel, Index=1)  # -> ListA, ListB
split_3 = SplitList(List=split_2.ListB, Index=1)  # -> ListA, ListB
split_4 = SplitList(List=split_3.ListB, Index=1)  # -> ListA, ListB
xy = XYPlane(Origin=split_3.ListA)
rectangle = Rectangle(Plane=xy, XSize=split_4.ListA, YSize=split_4.ListB, Radius=0)  # -> Rectangle, Length
area = Area(Geometry=rectangle.Rectangle)  # -> Area, Centroid
tag = TextTag(Location=area.Centroid, Text=split_2.ListA)
